# Dynamo graph IdentifyingDuplicatedWords.dyn (Dynamo 2.1.0.7500)

string = StringInput("\b(\w+?)\s\1\b")
all_options = FiltersByRule("IgnoreCase")
list_of_options = CodeBlock(x=all_options) { [x]; }
byPattern = RegularExpressions.Regex.ByPattern(pattern=string, options=list_of_options)
names = CodeBlock { "This this is a nice day. What about this? This tastes good. I saw a a dog."; }
matches = RegularExpressions.Regex.Matches(regex=byPattern, input=names)
