# Dynamo graph ReplacingSubstrings.dyn "RegexReplace" (Dynamo 2.1.0.7500)

pattern = CodeBlock { "(Mr\\.? |Mrs\\.? |Miss |Ms\\.? )"; }
byPattern = RegularExpressions.Regex.ByPattern(pattern=pattern)
names = CodeBlock()
# ---------- names.designscript (6 lines) ----------
[
	"Mr. Henry Hunt",
	"Ms. Sara Samuels",
	"Abraham Adams",
	"Ms. Nicole Norris"
];
# ----------------------------------------
code_block = CodeBlock { ""; }
replace = RegularExpressions.Regex.Replace(regex=byPattern, input=names, replacement=code_block)
