# Dynamo graph Regex.dyn (Dynamo 2.1.0.7500)

string = StringInput("[0-9]{2,5}")
regex = RegularExpressions.Regex.Regex(pattern=string)
string_2 = StringInput("av_avэль1245за_asa232v90")
isMatch = RegularExpressions.Regex.IsMatch(regex=regex, text=string_2)
matches = RegularExpressions.Regex.Matches(regex=regex, text=string_2)
